vi "Function.gvi"   [LabVIEW NXG 4.0.0]
panel controls:
  "String": string
panel indicators:
  "Chart": f64
diagram:
  while (iteration -> i1) {
    Wait(time to wait=100)
    Quotient And Remainder(x=i1, y=314) -> (x-y*floor(x/y)=w1)
    case ($String) {
      frame "sine", Default {
        Sine(x=w1) -> w2
      }
      frame "cosine" {
        Cosine(x=w1) -> w2
      }
      frame "tangent" {
        Tangent(x=w1) -> w2
      }
      frame "secant" {
        Secant(x=w1) -> w2
      }
      frame "invtan" {
        Inverse Tangent(x=w1) -> w2
      }
    }
    $Chart <- w2
    stop if FALSE
  }
